# Grasshopper definition AMv1_Inspect.gh (Grasshopper 1.0.8)

xy_plane = XYPlane(Origin=Point(0, 0, 0))
platform_path = Panel("C:\Users\leeja\Documents\dev\26_AdaptiveMold_development")
target_srf = Geometry(<surface referenced from the Rhino model>)
width = Slider(1000, range=100..4000)
length = Slider(1000, range=100..4000)
spacing = Slider(200, range=50..500)
max_height = Slider(400, range=50..1000)
min_height = Slider(0, range=0..500)
pin_radius = Slider(20, range=0..100)
normalized = BooleanToggle(True)
compute = BooleanToggle(True)
amv1_inspect = GhPythonScript(
    platform_path=platform_path,
    target_srf=target_srf,
    base_plane=xy_plane,
    width=width,
    length=length,
    spacing=spacing,
    max_height=max_height,
    min_height=min_height,
    pin_radius=pin_radius,
    normalized=normalized,
    compute=compute)  # -> pins_ok, pins_clamped, pins_ext, pin_tops, deck, positioned, extended, envelope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; inputs platform_path: String, target_srf: Brep, base_plane: Plane, width: Double, length: Double, spacing: Double, max_height: Double, min_height: Double, pin_radius: Double, normalized: Boolean, compute: Boolean, wire_extend: Double, wire_d_main: Double, wire_d_sub: Double, sub_per_gap: Double, v_per_gap: Double, sheet_si_t: Double, sheet_ht_t: Double
#   port platform_path: 저장소 루트의 절대경로. 이 경로 아래 adaptive_mold/src 를 sys.path에 넣어 파이프라인을 불러온다. 예: C:\Users\leeja\Documents\dev\26_AdaptiveMold_development 필수 — 비어 있으면 아무것도 계산되지 않는다.
#   port target_srf: 목표 곡면 (Surface 또는 Brep). 이 형상을 핀 격자로 재현한다. 필수. 타입 힌트가 Brep이라 Rhino 객체를 물려도 지오메트리로 변환돼 들어온다. 'expected Brep, got Guid'가 나오면 힌트가 빠진 것.
#   port base_plane: 몰드 베이스 평면. 핀은 이 평면 위에서 ZAxis 방향으로 선다. 비우면 WorldXY. 첫 그리드 점이 이 평면의 원점과 일치한다.
#   port width: 몰드 X 방향 크기 (mm). 기본 1000. 핀 개수 nx = width / spacing + 1.
#   port length: 몰드 Y 방향 크기 (mm). 기본 1000. 핀 개수 ny = length / spacing + 1.
#   port spacing: 핀(액추에이터) 간격 (mm). 기본 200. 줄이면 핀 사이 새그가 줄지만 액추에이터 개수가 제곱으로 늘어난다. 간격 200 · 6x6 기준 단곡면 새그는 3차 스플라인 모델로 0.16mm.
#   port max_height: 액추에이터 스트로크 상한 (mm). 기본 400. 이 값을 넘으려는 핀은 클램핑되고, 그 지점은 목표 형상을 재현하지 못한다. pins_clamped 출력으로 확인할 것.
#   port min_height: 액추에이터 스트로크 하한 (mm). 기본 0. Phase B가 목표 곡면을 (min+max)/2 근처로 옮기므로, 상·하한의 폭이 곧 재현 가능한 높이 범위가 된다.
#   port pin_radius: 핀 원기둥의 표시 반지름 (mm). 0이면 spacing*0.12로 자동. 표시용일 뿐 계산에는 영향이 없다.
#   port normalized: 사용하지 않는 입력. Phase B 회전 방식(현재 구현 vs 법선 정규화)을 눈으로 비교하던 진단 스위치였다. 정규화가 본 구현이 된 뒤로 무의미해졌고, 값을 바꿔도 결과가 변하지 않는다.
#   port compute: True일 때만 계산한다. 무거운 연산이 실수로 돌지 않게 하는 잠금. False면 모든 출력이 비고 info에 안내만 나온다.
#   port wire_extend: U 강선이 액추에이터 영역 밖으로 더 나가는 길이 (mm). 기본 250. 실물 사진에서 200~300mm로 관측된다. 주의: 강선을 따라 잰 길이다. 끝단 접선이 기울어져 있으면 수평 돌출은 이보다 짧다 (250 → 수평 230 실측). 오버행 구간은 접선 직선이다 — 마지막 핀 바깥은 하중도 모멘트도 없는 자유단이라 곡률이 이어지지 않는다.
#   port wire_d_main: U 굵은 강선의 지름 (mm). 기본 12. ← 가정치, 실물 사양 필요. 밑면이 핀 상단에 닿으므로 중심은 핀 상단 + 지름/2에 놓인다. 이 값이 커지면 성형면이 그만큼 더 위로 뜬다.
#   port wire_d_sub: V 강선과 U 보조 강선의 지름 (mm). 기본 6. ← 가정치. 두 계열이 같은 지름을 쓴다.
#   port sub_per_gap: 굵은 U 강선 사이에 넣을 보조 U 강선 개수. 기본 2. 0이면 보조 강선을 만들지 않는다. 총 개수 = (ny - 1) x 이 값.
#   port v_per_gap: 핀 열 사이에 추가할 V 강선 개수. 기본 2. 핀 열 위에는 항상 1본이 놓이므로 총 개수 = nx + (nx - 1) x 이 값.
#   port sheet_si_t: 실리콘 시트 두께 (mm). 기본 8. ← 가정치. 메쉬 상단(V 강선 윗면)에서부터 올라간다.
#   port sheet_ht_t: 내열 시트 두께 (mm). 기본 2. ← 가정치. 실리콘 위에 얹히고, 그 상면이 실제 성형면이다.
#   port pins_ok: 정상 범위의 핀 (Brep 원기둥). 회색 프리뷰 권장.
#   port pins_clamped: 스트로크 한계에 걸린 핀. 빨강 권장. 이 지점은 목표 곡면을 재현하지 못한다 — 하나라도 있으면 형상이나 스트로크 설정을 다시 봐야 한다.
#   port pins_ext: 확장 영역에 있는 핀. 노랑 권장. 원본 곡면 밖이라 높이가 외삽값이다.
#   port pin_tops: 핀 상단 점 nx*ny개. 순서는 idx = j*nx + i — X(i)가 먼저 변한다. 핀 높이를 목표 곡면에 레이캐스트해 구하므로, 이 점들은 정의상 목표 곡면 위에 놓인다.
#   port deck: 핀 상단을 잇는 쿼드 메시. 직선 데크이므로 물리 모델이 아니라 상한선이다. 실제 탄성 스트립은 3차 스플라인이고 새그가 훨씬 작다 — 직선 기준이 26배 과대평가한다(단곡 4.17 vs 0.16mm 실측).
#   port positioned: Phase B로 정렬된 목표 곡면. 기울기를 제거하고 스트로크 중앙 쪽으로 옮긴 상태.
#   port extended: Phase C로 몰드 범위까지 확장한 곡면. 원본 곡면 밖 구간은 외삽이므로 그 영역의 높이는 신뢰도가 낮다.
#   port envelope: 핀이 움직일 수 있는 공간 상자. width x length x [min_height, max_height]. 이 밖으로 나가려는 핀이 클램핑된다.
#   port deviation: 샘플점에서 정렬된 목표 곡면까지의 거리 (mm) 목록. 핀 상단이 아니라 핀 사이를 잰다 — 핀 상단은 정의상 곡면 위라 항상 0이고 재는 의미가 없다(동어반복). 샘플은 데크 메시의 면 중심과 엣지 중점.
#   port info: 통계 리포트 (문자열). 그리드 / 스트로크 / 핀 높이 폭 / 클램핑 / 확장영역 / 강선 메쉬 적층 높이 / 핀 사이 새그 / 폴백 가지 분포.
#   port wires: U 방향(X) 굵은 강선. ny본. 핀 상단 + 지름/2에 중심을 둔 3차 보간곡선이며 양 끝에 wire_extend 만큼 오버행이 붙는다. 3차 보간인 이유: 탄성 스트립은 변형에너지를 최소화하는 형상으로 안정되고 그 해가 자연 3차 스플라인이다.
#   port wires_sub: U 방향 보조 강선. 굵은 강선 사이에 sub_per_gap개씩. 핀이 받치지 않고 V 강선 밑면에 엮여 매달린다. 그래서 굵은 U 강선과 상단면 높이가 같다.
#   port wires_v: V 방향(Y) 강선. 굵은 U 강선 위를 가로지른다. 모든 교차점에서 굵은 U와 정확히 접한다(간격 = 두 반지름의 합).
#   port sheet_si: 실리콘 시트의 상면 (= 내열 시트의 하면). 높이 = 메쉬 상단 + sheet_si_t.
#   port sheet_ht: 내열 시트의 상면 = 실제 성형면. 높이 = 메쉬 상단 + 실리콘 두께 + 내열 두께. 주의: 핀 높이는 목표 곡면에 맞춰 계산되는데 그 위에 강선과 시트가 얹히므로, 이 면은 목표 곡면보다 스택 두께만큼 (기본값에서 28mm) 위에 있다. 실제로는 핀 높이에서 그만큼 빼야 성형면이 목표에 닿는다. 현재 미반영.
# ---------- amv1_inspect: Python ----------
# -*- coding: utf-8 -*-
# AMv1 Inspect — 몰드를 눈으로 보고 판단하기 위한 GhPython 컴포넌트
#
# 목적:
#   Phase B(곡면 정렬)의 회전 방식을 숫자가 아니라 형상으로 판단한다.
#   normalized 토글을 껐다 켜면서 몰드가 어떻게 달라지는지 본다.
#
#   normalized = False → 현재 구현 (진단상 기울기를 2배로 키움)
#   normalized = True  → fit 법선을 +Z 반구로 정규화한 뒤 +각도 회전
#
# GhPython 컴포넌트 Inputs (전부 item access, 없으면 기본값):
#   platform_path   str    repo root 경로 (필수)
#   target_srf      Surface/Brep  목표 곡면 (필수)
#   base_plane      Plane  기본 WorldXY
#   width           float  1000
#   length          float  1000
#   spacing         float  200
#   max_height      float  400
#   min_height      float  0
#   pin_radius      float  0 이면 spacing*0.12 자동
#   normalized      bool   False (현재 코드는 사용하지 않음 — 정규화가 본체가 됨)
#   wire_extend     float  강선 오버행, 없으면 250 (실물 관측 200~300)
#   wire_d_main     float  U 굵은 강선 지름, 없으면 12   ← 가정치
#   wire_d_sub      float  V·보조 U 강선 지름, 없으면 6  ← 가정치
#   sub_per_gap     int    굵은 U 사이 보조 U 개수, 없으면 2
#   v_per_gap       int    핀 열 사이 V 강선 개수, 없으면 2
#   sheet_si_t      float  실리콘 시트 두께, 없으면 8    ← 가정치
#   sheet_ht_t      float  내열 시트 두께, 없으면 2      ← 가정치
#   compute         bool   False
#
# Outputs:
#   pins_ok        정상 핀 (Brep)         — 회색 프리뷰 권장
#   pins_clamped   stroke 한계에 걸린 핀   — 빨강 권장
#   pins_ext       확장영역 핀             — 노랑 권장
#   pin_tops       핀 상단 점
#   wires          U방향 굵은 강선 (핀 위, 3차 보간곡선, 양 끝 오버행)
#   wires_sub      U방향 보조 강선 (굵은 것 사이, V 아래로 엮임)
#   wires_v        V방향 강선 (굵은 U 위를 가로지름)
#   sheet_si       실리콘 시트 상면 (= 내열 시트 하면)
#   sheet_ht       내열 시트 상면 = 실제 성형면
#   deck           핀 상단을 잇는 메시 (실제로 성형되는 면)
#   positioned     정렬된 목표 곡면
#   extended       확장된 곡면
#   envelope       stroke 범위 상자 (핀이 움직일 수 있는 공간)
#   deviation      핀 상단과 목표 곡면 사이 거리 (핀별)
#   info           통계 리포트

import sys
import os

import Rhino.Geometry as rg


# ── src 경로 등록 + 모듈 캐시 비우기 ────────────────────────
# Rhino의 Python은 프로세스가 살아 있는 동안 모듈을 캐시한다.
# src/를 고쳐도 반영되지 않으므로 매번 비운다.

_src = os.path.join(platform_path, "adaptive_mold", "src")
if _src not in sys.path:
    sys.path.insert(0, _src)

_norm = os.path.normcase(os.path.normpath(_src))
for _name in list(sys.modules.keys()):
    _p = getattr(sys.modules.get(_name), "__file__", None)
    if _p and os.path.normcase(os.path.normpath(_p)).startswith(_norm):
        del sys.modules[_name]

from adaptive_mold_v1 import run_adaptive_mold


# ── Guid 방어 ───────────────────────────────────────────
# GhPython 입력에 타입 힌트가 걸려 있지 않으면 Rhino 문서 객체가
# 지오메트리가 아니라 Guid로 넘어온다. 그러면 "target_srf is invalid"
# 또는 "expected Plane, got Guid"가 난다. 힌트가 정상이면 이 함수는
# 아무 일도 하지 않는다.

import System
import Rhino


def resolve(x):
    """Guid면 활성 Rhino 문서에서 지오메트리를 찾아 돌려준다."""
    if not isinstance(x, System.Guid):
        return x
    doc = Rhino.RhinoDoc.ActiveDoc
    if doc is None:
        return None
    obj = doc.Objects.FindId(x)
    return obj.Geometry if obj is not None else None


target_srf = resolve(target_srf)
base_plane = resolve(base_plane)


# ── 기본값 ──────────────────────────────────────────────

if base_plane is None:
    base_plane = rg.Plane.WorldXY
if width is None:
    width = 1000.0
if length is None:
    length = 1000.0
if spacing is None:
    spacing = 200.0
if max_height is None:
    max_height = 400.0
if min_height is None:
    min_height = 0.0
if not pin_radius:
    pin_radius = spacing * 0.12
if normalized is None:
    normalized = False

def _default(name, value, positive=False):
    """연결되지 않았거나 아직 파라미터가 없는 입력에 기본값을 넣는다.

    globals().get()을 쓰면 파라미터가 없어도 NameError가 나지 않는다 —
    컴포넌트에 입력을 추가하기 전에도 코드가 돈다.
    """
    g = globals()
    v = g.get(name)
    if v is None or (positive and v <= 0):
        g[name] = value


# 강선 오버행 — 액추에이터 영역 밖으로 더 나가는 길이.
# 실물 사진(image/adaptiveMold_image.png)에서 200~300mm로 관측된다.
# 주의: 강선을 따라 잰 길이다. 접선이 기울어져 있으면 수평 돌출은 이보다 짧다.
_default("wire_extend", 250.0, positive=True)

# 강선 지름과 밀도 — **전부 가정치.** 실물 장비 사양이 확정되면 교체할 것.
_default("wire_d_main", 12.0, positive=True)   # U 굵은 강선 (핀 위)
_default("wire_d_sub", 6.0, positive=True)     # V 강선 및 U 보조 강선
_default("sub_per_gap", 2)                     # 굵은 U 사이에 넣을 보조 U 개수
_default("v_per_gap", 2)                       # 핀 열 사이에 넣을 V 강선 개수
_default("sheet_si_t", 8.0, positive=True)     # 실리콘 시트 두께
_default("sheet_ht_t", 2.0, positive=True)     # 내열 시트 두께


pins_ok = []
pins_clamped = []
pins_ext = []
pin_tops = []
wires = []
wires_v = []
wires_sub = []
sheet_si = None
sheet_ht = None
deck = None
positioned = None
extended = None
envelope = None
deviation = []
info = ""


def make_pin(base_pt, normal, height, radius):
    """베이스 점에서 height 만큼 올라간 원기둥 하나."""
    if height <= 1e-9:
        height = 1e-9
    plane = rg.Plane(base_pt, normal)
    circle = rg.Circle(plane, radius)
    cyl = rg.Cylinder(circle, height)
    return cyl.ToBrep(True, True)


def make_deck_mesh(tops, nx, ny):
    """핀 상단을 잇는 쿼드 메시. 실제로 성형되는 면에 해당한다."""
    if len(tops) != nx * ny:
        return None
    mesh = rg.Mesh()
    for p in tops:
        mesh.Vertices.Add(p)
    for j in range(ny - 1):
        for i in range(nx - 1):
            a = j * nx + i
            b = a + 1
            c = a + nx + 1
            d = a + nx
            mesh.Faces.AddFace(a, b, c, d)
    mesh.Normals.ComputeNormals()
    mesh.Compact()
    return mesh


# ── 강선 메쉬 · 시트 적층 ─────────────────────────────────
#
# 적층 순서 (아래 → 위):
#   핀 상단 ─ U 굵은 강선(핀 위) ─ V 강선(굵은 U 위를 가로지름)
#            ─ U 보조 강선(V 아래로 엮임, 굵은 U 사이) ─ 실리콘 ─ 내열 시트
#
# 굵은 U와 보조 U는 **상단면이 같다** — 둘 다 V 강선의 밑면에 닿는다.
# 굵은 U는 핀이 받치고, 보조 U는 핀이 없어 V 강선에 엮여 매달린다.
#
# 강선 형상 두 가지 규칙:
#
# 1. **직선 폴리라인이 아니라 3차 보간곡선.** 탄성 스트립은 변형에너지(∫κ²)를
#    최소화하는 형상으로 안정되고 그 해가 자연 3차 스플라인이다. 직선 데크는
#    물리 모델이 아니라 상한선이며 새그를 26배 과대평가한다(J-004 FACT-01).
#
# 2. **오버행은 접선 직선**(`CurveExtensionStyle.Line`). 마지막 핀 바깥은
#    하중도 모멘트도 없는 자유단이라 직선이 된다. 곡률을 이어가는 Smooth
#    연장은 자유단에 모멘트가 남아 있다는 뜻이어서, 끝을 붙잡는 장치가
#    실제로 있을 때만 맞다.

def deck_surface(tops, nx, ny):
    """핀 상단을 지나는 쌍3차 곡면. (u,v)가 어느 인덱스인지 스스로 확인한다.

    `NurbsSurface.CreateThroughPoints(points, uCount, vCount, ...)`의 점 순서
    규약을 이름으로 추측하면 nx != ny일 때 U/V가 뒤바뀐 채로 그려지고,
    그림은 그럴듯하게 나오므로 한참 뒤에 발견된다. 그래서 두 조합을 만들어
    **모서리가 맞는 쪽**을 고른다.

    돌려주는 것: (surface, u_is_j)
      u_is_j=True  → u가 j(행, Y) 방향, v가 i(열, X) 방향
    """
    corner_j = tops[(ny - 1) * nx]      # i=0, j=max
    corner_i = tops[nx - 1]             # i=max, j=0
    for u_count, v_count, u_is_j in ((ny, nx, True), (nx, ny, False)):
        srf = rg.NurbsSurface.CreateThroughPoints(tops, u_count, v_count, 3, 3,
                                                  False, False)
        if srf is None:
            continue
        du, dv = srf.Domain(0), srf.Domain(1)
        want = corner_j if u_is_j else corner_i
        if srf.PointAt(du.T1, dv.T0).DistanceTo(want) < 1e-6:
            return srf, u_is_j
    return None, True


def _up_normal(srf, u, v, up):
    """곡면 법선을 up 쪽 반구로 정규화한다. 법선 방향은 보장되지 않는다."""
    n = srf.NormalAt(u, v)
    if n.IsValid and n * up < 0:
        n.Reverse()
    return n


def offset_iso(srf, u_is_j, along_x, const_param, dist, up, overhang,
               samples=48):
    """곡면의 아이소커브를 법선 방향으로 dist 띄운 곡선.

    곡면을 오프셋한 뒤 아이소커브를 뽑지 않는다 — 오프셋 곡면의 매개화가
    같다는 보장이 없다. 점을 샘플링해 각 점의 법선으로 옮기고 다시 보간한다.

    along_x=True 이면 X(=i) 방향 강선, False 이면 Y(=j) 방향 강선.
    """
    # X방향 강선은 (u_is_j일 때) v를 따라 변한다 → IsoCurve(1, u)
    iso_dir = 1 if (along_x == u_is_j) else 0
    iso = srf.IsoCurve(iso_dir, const_param)
    if iso is None:
        return None

    dom = iso.Domain
    pts = []
    for k in range(samples + 1):
        t = dom.T0 + dom.Length * k / float(samples)
        p = iso.PointAt(t)
        ok, u, v = srf.ClosestPoint(p)
        if not ok:
            continue
        pts.append(p + _up_normal(srf, u, v, up) * dist)
    if len(pts) < 4:
        return None

    crv = rg.Curve.CreateInterpolatedCurve(pts, 3)
    if crv is None:
        return None
    if overhang and overhang > 0:
        ext = crv.Extend(rg.CurveEnd.Both, overhang, rg.CurveExtensionStyle.Line)
        if ext is not None:
            crv = ext
    return crv


def offset_sheet(srf, tops_uv, nx, ny, dist, up):
    """핀 격자 위치의 점들을 법선으로 dist 띄워 만든 시트 곡면."""
    pts = []
    for (u, v) in tops_uv:
        pts.append(srf.PointAt(u, v) + _up_normal(srf, u, v, up) * dist)
    sheet, _ = deck_surface(pts, nx, ny)
    return sheet


def make_envelope(plane, w, l, hmin, hmax):
    """핀이 움직일 수 있는 공간. 여기를 벗어나면 클램핑이다."""
    box = rg.Box(plane,
                 rg.Interval(0, w),
                 rg.Interval(0, l),
                 rg.Interval(hmin, hmax))
    return box.ToBrep()


if compute and target_srf is not None:
    r = run_adaptive_mold(
        target_srf,
        base_plane=base_plane,
        width=width, length=length, spacing=spacing,
        max_height=max_height, min_height=min_height,
        compute=True,
        component=ghenv.Component,
    )

    positioned = r.positioned_srf
    extended = r.extended_srf
    pin_tops = list(r.pin_tops)
    envelope = make_envelope(base_plane, width, length, min_height, max_height)

    normal = base_plane.ZAxis
    for idx, (pt, h) in enumerate(zip(r.grid_pts, r.pin_heights)):
        pin = make_pin(pt, normal, h, pin_radius)
        if pin is None:
            continue
        if r.clamp_flags[idx]:
            pins_clamped.append(pin)
        elif r.extension_flags[idx]:
            pins_ext.append(pin)
        else:
            pins_ok.append(pin)

    nx = int(width // spacing) + 1
    ny = int(length // spacing) + 1
    deck = make_deck_mesh(pin_tops, nx, ny)

    # ── 강선 메쉬 ────────────────────────────────────────
    up = base_plane.ZAxis
    r_main = wire_d_main / 2.0
    r_sub = wire_d_sub / 2.0

    z_main = r_main                        # 굵은 U 중심 — 밑면이 핀 상단에 닿는다
    z_v = 2.0 * r_main + r_sub             # V 중심 — 굵은 U 위에 얹힌다
    z_sub = 2.0 * r_main - r_sub           # 보조 U 중심 — V 밑면에 닿는다
    mesh_top = 2.0 * r_main + 2.0 * r_sub  # 메쉬 상단 = V 강선 윗면

    srf0, u_is_j = deck_surface(pin_tops, nx, ny)

    if srf0 is not None:
        tops_uv = []
        for p in pin_tops:
            ok, u, v = srf0.ClosestPoint(p)
            tops_uv.append((u, v) if ok else (0.0, 0.0))

        def row_param(j):
            """X(=U)방향 강선의 상수 파라미터 — 행 j."""
            u, v = tops_uv[j * nx]
            return u if u_is_j else v

        def col_param(i):
            """Y(=V)방향 강선의 상수 파라미터 — 열 i."""
            u, v = tops_uv[i]
            return v if u_is_j else u

        def span(params, per_gap):
            """격자선 파라미터 사이에 per_gap개씩 끼운 목록."""
            out = []
            for k in range(len(params) - 1):
                a, b = params[k], params[k + 1]
                for m in range(1, per_gap + 1):
                    out.append(a + (b - a) * m / float(per_gap + 1))
            return out

        # 굵은 U — 핀 행마다 1본
        for j in range(ny):
            c = offset_iso(srf0, u_is_j, True, row_param(j), z_main, up,
                           wire_extend)
            if c is not None:
                wires.append(c)

        # 보조 U — 굵은 U 사이에 sub_per_gap개씩, V 강선 아래로
        for prm in span([row_param(j) for j in range(ny)], int(sub_per_gap)):
            c = offset_iso(srf0, u_is_j, True, prm, z_sub, up, wire_extend)
            if c is not None:
                wires_sub.append(c)

        # V — 핀 열마다 1본 + 열 사이에 v_per_gap개씩
        col_params = [col_param(i) for i in range(nx)]
        for prm in col_params + span(col_params, int(v_per_gap)):
            c = offset_iso(srf0, u_is_j, False, prm, z_v, up, wire_extend)
            if c is not None:
                wires_v.append(c)

        # 시트 — 메쉬 상단에 실리콘, 그 위에 내열. 출력은 각 시트의 상면이고
        # 내열 상면이 실제 성형면이다.
        sheet_si = offset_sheet(srf0, tops_uv, nx, ny,
                                mesh_top + sheet_si_t, up)
        sheet_ht = offset_sheet(srf0, tops_uv, nx, ny,
                                mesh_top + sheet_si_t + sheet_ht_t, up)

    # ── 이탈량 — 몰드 품질의 핵심 지표 ────────────────────
    #
    # 핀 상단을 재면 안 된다. 핀 높이는 목표 곡면에 레이캐스트해서 구하므로
    # 핀 상단은 정의상 곡면 위에 있고, 그 거리는 항상 0이다(동어반복).
    #
    # 실제로 재야 하는 것은 **핀과 핀 사이**다. 핀은 이산적인 지지점이고
    # 그 사이의 데크는 목표 곡면을 따라가지 못한다. 이 새그(sagitta)가
    # 몰드가 그 형상을 재현할 수 있는지를 말해준다.
    #   - 평면·단곡: 거의 0 (핀 격자로 잘 근사됨)
    #   - 안장형:    커짐 (핀 격자로 근사하기 어려운 형상)

    probe = positioned
    if probe is not None and not isinstance(probe, rg.Brep):
        probe = probe.ToBrep()

    if probe is not None and deck is not None:
        samples = []
        for f in range(deck.Faces.Count):
            samples.append(deck.Faces.GetFaceCenter(f))
        for e in range(deck.TopologyEdges.Count):
            ln = deck.TopologyEdges.EdgeLine(e)
            samples.append(ln.PointAt(0.5))
        for p in samples:
            cp = probe.ClosestPoint(p)
            deviation.append(p.DistanceTo(cp) if cp is not None else None)

    valid_dev = [d for d in deviation if d is not None]
    n_clamped = sum(1 for c in r.clamp_flags if c)
    n_ext = sum(1 for e in r.extension_flags if e)
    heights = [h for h in r.pin_heights if h is not None]

    branch_counts = {}
    for b in r.branch_taken:
        branch_counts[b] = branch_counts.get(b, 0) + 1

    stack_total = mesh_top + sheet_si_t + sheet_ht_t

    lines = [
        "AMv1 Inspect",
        "=" * 40,
        "그리드:      {} x {} = {} 핀".format(nx, ny, nx * ny),
        "stroke:      {:.0f} ~ {:.0f} mm".format(min_height, max_height),
        "",
        "핀 높이:     min={:.1f}  max={:.1f}  폭={:.1f} mm".format(
            min(heights) if heights else 0,
            max(heights) if heights else 0,
            (max(heights) - min(heights)) if heights else 0),
        "             <- 평면 패널이면 폭이 0이어야 정렬이 맞은 것",
        "클램핑:      {} / {}   <- 0이 아니면 그 지점은 목표를 재현 못 함".format(
            n_clamped, len(r.pin_heights)),
        "확장영역:    {} / {}   <- 원본 곡면 밖, 높이가 외삽값".format(
            n_ext, len(r.pin_heights)),
        "",
        "강선 메쉬:",
        "  U 굵은 (ø{:.0f}): {:>3}본  길이 {:.0f} mm  오버행 {:.0f} mm/끝(곡선따라)".format(
            wire_d_main, len(wires),
            max(c.GetLength() for c in wires) if wires else 0, wire_extend),
        "  U 보조 (ø{:.0f}): {:>3}본  굵은 강선 사이 {}개씩, V 아래로 엮임".format(
            wire_d_sub, len(wires_sub), int(sub_per_gap)),
        "  V      (ø{:.0f}): {:>3}본  핀 열마다 + 열 사이 {}개씩".format(
            wire_d_sub, len(wires_v), int(v_per_gap)),
        "  적층(핀 상단 기준): U중심 {:.1f} / 보조U중심 {:.1f} / V중심 {:.1f} / 메쉬상단 {:.1f} mm".format(
            z_main, z_sub, z_v, mesh_top),
        "  시트: 실리콘 {:.0f} + 내열 {:.0f}  ->  성형면 = 핀 상단 +{:.1f} mm".format(
            sheet_si_t, sheet_ht_t, stack_total),
        "  ** 핀 높이는 목표곡면에 맞춰 계산된다. 그 위에 스택이 얹히므로",
        "     성형면이 목표곡면보다 {:.1f} mm 위로 뜬다 — 핀 높이에서 그만큼".format(stack_total),
        "     빼야 맞는다. 지금은 미반영(Phase A~D 동작을 바꾸지 않기 위해).",
        "  ** 강선 지름·개수·시트 두께는 전부 가정치. 실물 사양 필요.",
        "",
        "핀 사이 새그: max={:.3f}  avg={:.3f} mm  ({}점 샘플)".format(
            max(valid_dev) if valid_dev else 0,
            sum(valid_dev) / len(valid_dev) if valid_dev else 0,
            len(valid_dev)),
        "             <- 핀 격자가 그 형상을 못 따라가는 정도",
        "폴백 가지:   {}".format(branch_counts),
        "",
        r.info,
    ]
    info = "\n".join(lines)

else:
    info = "compute=True 로 설정하고 target_srf를 연결하세요."
# ---------- end amv1_inspect ----------
amv1_rollerpath = AMv1RollerPath(platform_path=platform_path, mold_srf=amv1_inspect.sheet_ht, base_plane=xy_plane, compute=compute)  # -> out, paths, targets, roller_lines, contact, info, move_kind, path_full, path_air; inputs platform_path: String, mold_srf: Brep, base_plane: Plane, sheet_t: Double, roller_d: Double, roller_w: Double, stepover: Double, passes: Double, axis_mode: String, start_center: Boolean, compute: Boolean, zigzag: Boolean, clearance: Double, order_mode: String
#   port platform_path: 저장소 루트의 절대경로. adaptive_mold/src 의 toolpath 모듈을 불러온다. 필수.
#   port mold_srf: 성형면 = 내열 시트 상면. AMv1 Inspect 의 sheet_ht 출력을 물린다. 필수. 목표 곡면이 아니라 성형면이어야 한다 — 판재가 실제로 닿는 면은 강선과 시트 스택 위쪽이다.
#   port base_plane: 몰드 베이스 평면. 법선 방향(위쪽)을 정하는 기준이고, 점진 가압에서 중간 깊이를 보간하는 기준면이다. 비우면 WorldXY.
#   port sheet_t: 금속 박판 두께 (mm). 기본 1.5. 롤러 중심은 접촉점에서 법선으로 (두께 + 롤러반지름)만큼 뜬다.
#   port roller_d: 롤러 지름 (mm). 기본 60. 작을수록 국부 성형에 가깝고 흠이 남기 쉽다. 클수록 하중이 퍼지지만 오목한 곳에 들어가지 못한다.
#   port roller_w: 롤러 폭 = 접촉선 길이 (mm). 기본 80. 경로 계산에는 쓰이지 않고 접촉선이 곡면에 앉는지 판정(seat)에 쓰인다. 축 방향으로 곡률이 있으면 폭이 길수록 틈이 커진다.
#   port stepover: 패스 간격 (mm). 0이면 roller_w * 0.5 (50% 겹침). 패스 개수는 ceil로 올려 잡는다 — 내림하면 실측 간격이 설정보다 커져 겹침이 요청보다 적어진다. 겹침은 부족한 쪽으로 틀리면 안 된다.
#   port passes: 점진 가압 패스 수. 기본 1. 2 이상이면 베이스 평면과 성형면 사이를 선형 보간한 중간 깊이를 먼저 지난다. 주의: 중간 형상은 기하 가정이다. 실제로 판재가 어떤 중간 형상을 지나는지는 해석이나 실측 없이는 알 수 없다.
#   port axis_mode: 진행 방향 결정. auto / u / v. auto는 곡면 중앙의 주곡률을 재서 |κ|가 큰 주방향에 가까운 매개방향을 고른다. 롤러는 진행 방향으로만 굽힘을 주고 축 방향으로는 못 주므로, 축이 곡률이 작은 방향에 놓여야 접촉선이 앉는다.
#   port start_center: 구버전 호환용. order_mode가 지정되면 무시된다. True = center-alt, False = sequential 과 같다.
#   port compute: True일 때만 계산한다.
#   port zigzag: True면 왕복(홀수 패스를 거꾸로) 진행. 기본 True. 순서만 뒤집는 것이 아니라 타겟 자세의 XAxis도 함께 뒤집는다. 공중 이동거리 실측: 지그재그 off 30,430 mm → on 13,000 mm (center-alt 기준). 끄면 매 패스마다 판을 가로질러 되돌아간다. 롤러 진행 방향이 매번 바뀌는 것이 표면·스프링백에 영향을 주는 공정이라면 끌 것.
#   port clearance: 접근·후퇴 높이 (mm). 기본 30. 패스 시작 전에 법선 방향으로 이만큼 띄운 지점에서 내려오고, 끝나면 다시 띄운다. 성형 자세는 유지한다. 0이면 접근·후퇴 타겟을 만들지 않는다 — 그 경우 롤러가 판재를 누른 채 다음 패스로 가로질러 긁는다.
#   port order_mode: 패스를 지날 순서. 기본 center-half. center-half : 중앙 → 한쪽 끝, 다시 중앙 → 반대쪽. center-alt : 중앙에서 좌우 번갈아. 재료 흐름이 대칭이다. sequential : 한쪽 끝에서 순서대로. 주름은 자유 경계에서 시작해 안으로 밀려오므로 중앙을 먼저 앉히고 여분을 바깥으로 밀어내야 한다. sequential은 그 여분이 반대쪽에 쌓인다. 공중 이동거리 실측 (26패스, 지그재그 on): center-alt 13,000 mm (홉 40~1000) center-half 1,480 mm (홉 40~520) sequential 1,000 mm (홉 40 고정) center-half가 중앙-바깥 논리를 유지하면서 이동을 1/8.8로 줄인다. 다만 좌우 비대칭이 성형에 영향을 주는지는 측정된 바 없다.
#   port paths: 성형 구간만. 진행 순서대로 정렬돼 있다. 롤러 중심선이며 접촉점 경로가 아니다 — 법선으로 (판두께 + 롤러반지름)만큼 뜬 선이다.
#   port targets: 로봇 타겟 Plane. 경로 순서대로 평탄화돼 있다. 규약: origin = 롤러 중심, ZAxis = 곡면 법선의 반대(내려누르는 방향), XAxis = 진행 접선, YAxis = 롤러 축. 포스트프로세서는 이 규약만 알면 된다.
#   port roller_lines: 각 경로 시작점에서의 롤러 축 표시선 (길이 = roller_w). 자세가 맞는지 눈으로 확인하는 용도.
#   port contact: 판재와 롤러가 닿는 점. 성형면 위에 있다. targets 와 같은 순서·같은 개수.
#   port info: 진단 리포트. 진행 방향 / 패스 수 / 설정 대비 실측 간격 / 롤러 중심 오프셋 / 접촉선 앉음 틈(seat). seat 값이 크면 형상 자체가 선접촉을 허용하지 않는다는 뜻이다 — 경로를 고칠 문제가 아니라 롤러 폭을 줄이거나 구면 공구로 바꿔야 한다.
#   port move_kind: targets와 같은 순서·같은 개수의 구간 종류 문자열. approach : 접근 (공중, 성형 시작점 위) form : 성형 (가압하며 굴린다) retract : 후퇴 (공중) link : 다음 패스로 가는 이동 (공중, 몰드면 간격 유지) 포스트프로세서가 이 값으로 이동 종류와 속도를 갈라야 한다. form 구간만 힘/깊이 제어를 걸고, 나머지는 빠른 공중 이동이다.
#   port path_full: 전체 툴패스 하나 (PolyCurve). 접근 → 성형 → 후퇴 → 이동 → 다음 접근 … 이 끊김 없이 이어져 있다(세그먼트 사이 틈 0.000000 실측). 로봇이 실제로 그리는 궤적이 이것이다. paths 는 성형 구간만이라 경로가 끊겨 보인다.
#   port path_air: 공중 구간만 — 접근·후퇴 직선과 패스 사이 이동 곡선. 이동 구간은 몰드면에서 (성형높이 + clearance)를 유지하는 곡선이다. 직선으로 이으면 볼록한 곡면 위에서 현이 면 아래로 파고들어 판재나 몰드를 친다. 실측 표면간격 31.50 ~ 61.50 mm.
# ---------- amv1_rollerpath: Python ----------
# -*- coding: utf-8 -*-
# AMv1 RollerPath — 로봇암 롤러가 금속 박판을 몰드면에 눌러 앉히는 경로
#
# 계산은 adaptive_mold/src/toolpath.py 에 있다. 이 컴포넌트는 얇은 어댑터다.
#
# Inputs (전부 item, 비우면 기본값):
#   platform_path  str      repo root (필수)
#   mold_srf       Surface/Brep  성형면 = 내열 시트 상면 (필수)
#   base_plane     Plane    몰드 베이스. 비우면 WorldXY
#   sheet_t        float    금속 박판 두께, 없으면 1.5
#   roller_d       float    롤러 지름, 없으면 60
#   roller_w       float    롤러 폭(접촉선 길이), 없으면 80
#   stepover       float    패스 간격, 0이면 roller_w*0.5
#   passes         int      점진 가압 패스 수, 없으면 1
#   axis_mode      str      auto | u | v  (진행 방향 강제)
#   start_center   bool     (구버전 호환) order_mode가 있으면 무시됨
#   order_mode     str      center-half | center-alt | sequential
#   zigzag         bool     왕복 진행, 없으면 True
#   clearance      float    접근·후퇴 높이, 없으면 30
#   compute        bool     False면 계산하지 않는다
#
# Outputs:
#   path_full      전체 툴패스 하나 (성형 + 접근/후퇴/이동이 이어진 것)
#   paths          성형 구간만
#   path_air       공중 구간만 (접근·후퇴·이동)
#   targets        로봇 타겟 Plane (실행 순서대로 평탄화)
#   move_kind      targets와 같은 순서의 구간 종류
#                  (approach / form / retract / link)
#   roller_lines   각 경로 시작점의 롤러 축 표시선
#   contact        판재-롤러 접촉점
#   info           진단 리포트

import sys
import os

import Rhino.Geometry as rg


_src = os.path.join(platform_path, "adaptive_mold", "src")
if _src not in sys.path:
    sys.path.insert(0, _src)

_norm = os.path.normcase(os.path.normpath(_src))
for _name in list(sys.modules.keys()):
    _p = getattr(sys.modules.get(_name), "__file__", None)
    if _p and os.path.normcase(os.path.normpath(_p)).startswith(_norm):
        del sys.modules[_name]

from toolpath import generate_roller_paths


def _default(name, value, positive=False):
    g = globals()
    v = g.get(name)
    if v is None or (positive and v <= 0):
        g[name] = value


_default("sheet_t", 1.5, positive=True)
_default("roller_d", 60.0, positive=True)
_default("roller_w", 80.0, positive=True)
_default("stepover", 0.0)
_default("passes", 1, positive=True)
_default("axis_mode", "auto")
_default("start_center", True)
_default("zigzag", True)
_default("clearance", 30.0)
# center-half 가 기본 — 중앙에서 바깥으로 미는 논리를 유지하면서 공중 이동이
# center-alt의 1/8.8이다 (실측 1,480 vs 13,000 mm).
_default("order_mode", "center-half")

if base_plane is None:
    base_plane = rg.Plane.WorldXY


path_full = None
paths = []
path_air = []
targets = []
move_kind = []
roller_lines = []
contact = []
info = ""


if compute and mold_srf is not None:
    r = generate_roller_paths(
        mold_srf,
        base_plane=base_plane,
        sheet_t=sheet_t,
        roller_d=roller_d,
        roller_w=roller_w,
        stepover=stepover,
        passes=int(passes),
        axis_mode=str(axis_mode),
        start_center=bool(start_center),
        zigzag=bool(zigzag),
        clearance=clearance,
        order_mode=str(order_mode),
    )

    path_full = r.path_full
    paths = r.paths
    path_air = r.paths_air
    roller_lines = r.roller_lines
    for group in r.targets:
        targets.extend(group)
    for group in r.move_kinds:
        move_kind.extend(group)
    for group in r.contact:
        contact.extend(group)

    d = r.info
    if d.get("error"):
        info = "오류: {}".format(d["error"])
    else:
        so = d.get("stepover_measured")
        seat_max = d.get("seat_error_max")
        lines = [
            "AMv1 RollerPath",
            "=" * 40,
            "진행 방향:   {} 매개방향  (축은 그 직각)".format(d["travel"]),
            "             <- 롤러는 진행 방향으로만 굽힘을 준다.",
            "                축 방향에 곡률이 있으면 접촉선이 앉지 않는다.",
            "",
            "패스:        {}본 x {}회 = {}개".format(
                d["n_paths_per_pass"], d["passes"], d["path_count"]),
            "타겟:        성형 {}개 + 이동 {}개 = {}개".format(
                d["form_targets"], d["air_targets"], d["target_count"]),
            "진행:        {}  순서 {}  (접근·후퇴 높이 {:.0f} mm)".format(
                "왕복 지그재그" if d["zigzag"] else "단방향",
                d["order_mode"], d["clearance"]),
            "패스간 이동: {} mm  합계 {:.0f} mm".format(
                "{:.0f} ~ {:.0f}".format(d["link_min"], d["link_max"])
                if d["link_min"] is not None else "?",
                d["link_total"]),
            "             <- 몰드면에서 간격을 유지하는 곡선이다. 직선으로 이으면",
            "                볼록면 위에서 현이 면 아래로 파고든다",
            "",
            "전체 경로:   {:.0f} mm  (성형 {:.0f} + 공중 {:.0f})  세그먼트 {}개".format(
                d["len_total"], d["len_form"], d["len_air"], d["full_segments"]),
            "             <- path_full 이 처음부터 끝까지 이어진 하나의 곡선이다",
            "간격:        설정 {:.1f} mm  실측 {} mm".format(
                d["stepover_set"],
                "{:.1f} ~ {:.1f}".format(so[0], so[1]) if so else "?"),
            "             <- 매개변수 등분이라 실측이 설정과 다를 수 있다",
            "롤러 중심:   접촉점에서 법선으로 {:.1f} mm (판두께 {:.1f} + 반지름 {:.1f})".format(
                d["roller_center_offset"], sheet_t, roller_d / 2.0),
            "",
            "접촉선 앉음: 최대 틈 {} mm  (롤러 폭 {:.0f} 기준)".format(
                "{:.3f}".format(seat_max) if seat_max is not None else "?",
                roller_w),
            "             <- 0에 가까울수록 선접촉. 커지면 점접촉이 되어",
            "                하중이 몰리고 판재에 흠이 난다. 형상 자체의",
            "                한계이지 경로 문제가 아니다 — 롤러 폭을 줄이거나",
            "                구면 공구로 바꿔야 한다.",
        ]
        if d.get("progressive_is_geometric"):
            lines += [
                "",
                "** 점진 가압 중간 깊이는 기하 가정이다.",
                "   실제 중간 형상은 해석(또는 실측) 없이는 알 수 없다.",
            ]
        lines += [
            "",
            "** 순서는 중앙 → 좌우 교대. 주름은 자유 경계에서 시작해 안으로",
            "   밀려오므로, 중앙을 먼저 앉히고 여분을 바깥으로 밀어낸다.",
        ]
        info = "\n".join(lines)
else:
    info = "compute=True 로 설정하고 mold_srf(성형면)를 연결하세요."
# ---------- end amv1_rollerpath ----------
geometry = Geometry(amv1_inspect.envelope)
geometry_2 = Geometry(amv1_inspect.deck)
geometry_3 = Geometry(amv1_inspect.positioned)
geometry_4 = Geometry(amv1_inspect.extended)
geometry_5 = Geometry(amv1_inspect.wires_sub)
geometry_6 = Geometry(amv1_inspect.wires_v)
geometry_7 = Geometry(amv1_inspect.pins_ok)
geometry_8 = Geometry(amv1_inspect.wires)
geometry_9 = Geometry(amv1_inspect.sheet_si)
geometry_10 = Geometry(amv1_inspect.sheet_ht)
panel = Panel(amv1_inspect.pins_clamped)
geometry_11 = Geometry(amv1_rollerpath.paths)
info = Panel(amv1_inspect.info)
amv1_robot = AMv1Robot(platform_path=platform_path, targets=amv1_rollerpath.targets, move_kind=amv1_rollerpath.move_kind, compute=compute)  # -> out, links, tcp, poses, reach_err, unreachable, info; inputs platform_path: String, targets: list, move_kind: list, robot_base: Plane, frame: Double, step: Double, iterations: Double, rot_weight: Double, compute: Boolean
#   port platform_path: 저장소 루트의 절대경로. adaptive_mold/src/robot.py 를 불러온다.
#   port targets: AMv1 RollerPath 의 targets 출력. list access 여야 한다. item으로 잡히면 첫 타겟만 들어와 '로봇이 한 점에만 간다'는 엉뚱한 증상이 된다.
#   port move_kind: RollerPath 의 move_kind (선택). 있으면 구간별로 오차를 집계한다.
#   port robot_base: 로봇 베이스 Plane. 비우면 몰드 중심에서 -X로 1900mm 지점. 실측 비교 (전 타겟 1,175개, 연속 시드): base_x -1400 : max 5.0mm 평균 0.27 실패 16 base_x -1300 : max 7.1mm 평균 0.35 실패 46 base_x -1200 : max 9.4mm 평균 0.43 실패 46 가까이 옮기면 나빠진다. X 이동으로는 더 못 줄인다.
#   port frame: 이 인덱스의 포즈로 로봇을 그린다. 애니메이션 슬라이더용. 범위를 넘으면 마지막 포즈로 잘린다.
#   port step: N개마다 하나만 계산. 기본 1. 주의: step>1 이면 오차 수치를 신뢰할 수 없다. IK가 앞 포즈를 시드로 쓰는데 타겟을 건너뛰면 시드가 멀어져 수렴이 깨진다 (실측: step=10에서 max 1,850mm). 미리보기 전용.
#   port iterations: IK 최대 반복. 기본 30. 실측: 100으로 올려도 실패 개수는 줄지 않았다(10 → 11). 남은 오차는 수렴 문제가 아니라 그 지점의 기하적 도달 한계다.
#   port rot_weight: 자세 오차 가중치. 기본 0.4. 0이면 위치 전용 IK. 롤러는 자세가 틀어지면 접촉선이 어긋나므로 0으로 두지 말 것.
#   port compute: True일 때만 계산한다. 1,175 타겟이면 수십 초 걸린다.
#   port links: 현재 frame 의 로봇 링크 선 — 베이스에서 관절 피벗을 거쳐 TCP까지. GLB 메시가 아니라 골격이다. 자세·도달을 판단하는 데는 충분하다.
#   port tcp: 현재 frame 의 TCP Plane (mm, 월드). 규약: Z = 접근축, X = 롤러 축.
#   port poses: 전 구간 관절각 (deg). 타겟마다 j1~j6 순으로 6개씩 이어진 평탄 목록.
#   port reach_err: 타겟별 위치 오차 (mm). 2mm 초과를 도달 실패로 본다. 이 값이 크면 롤러가 표면에서 뜬 것이다.
#   port unreachable: 오차가 2mm를 넘은 타겟의 인덱스. 규칙적인 간격으로 나타나면 특정 위치의 기하적 한계다 — 반복 횟수를 늘려도 줄지 않는다.
#   port info: 진단 리포트. 베이스 위치 / 오차 / 도달 실패 / 가동범위 접촉 / 롤러 대칭 활용 횟수 / 사이클 타임 / 구간별 최대 오차.
# ---------- amv1_robot: Python ----------
# -*- coding: utf-8 -*-
# AMv1 Robot — IRB6700이 롤러 툴패스를 추종할 수 있는지 보고, 포즈를 만든다
#
# 기구학은 adaptive_mold/src/robot.py (웹 시뮬레이터에서 이식, 대조 완료).
#
# Inputs:
#   platform_path  str     repo root (필수)
#   targets        Plane*  AMv1 RollerPath 의 targets (list access)
#   move_kind      str*    같은 순서의 구간 종류 (선택). 있으면 구간별로 집계한다
#   robot_base     Plane   로봇 베이스. 비우면 몰드 중심에서 -X로 1900mm 떨어진 곳
#   frame          int     이 인덱스의 포즈로 로봇을 그린다 (애니메이션 슬라이더)
#   step           int     N개마다 하나만 계산, 없으면 1 (미리보기 가속)
#   iterations     int     IK 최대 반복, 없으면 30
#   rot_weight     float   자세 가중치, 없으면 0.4 (0이면 위치 전용)
#   compute        bool
#
# Outputs:
#   links          현재 frame 의 로봇 링크 선
#   tcp            현재 frame 의 TCP Plane
#   poses          전 구간 관절각 (6개씩 이어진 평탄 목록, deg)
#   reach_err      타겟별 위치 오차 (mm)
#   unreachable    오차가 큰 타겟의 인덱스
#   info           진단 리포트

import sys
import os

import Rhino.Geometry as rg


_src = os.path.join(platform_path, "adaptive_mold", "src")
if _src not in sys.path:
    sys.path.insert(0, _src)

_norm = os.path.normcase(os.path.normpath(_src))
for _name in list(sys.modules.keys()):
    _p = getattr(sys.modules.get(_name), "__file__", None)
    if _p and os.path.normcase(os.path.normpath(_p)).startswith(_norm):
        del sys.modules[_name]

import robot as rb


def _default(name, value, positive=False):
    g = globals()
    v = g.get(name)
    if v is None or (positive and v <= 0):
        g[name] = value


_default("frame", 0)
_default("step", 1, positive=True)
_default("iterations", 30, positive=True)
_default("rot_weight", 0.4)

REACH_TOL_MM = 2.0          # 이보다 크면 롤러가 표면에서 뜬 것으로 본다


links = []
tcp = None
poses = []
reach_err = []
unreachable = []
info = ""


if compute and targets:
    tgts = list(targets)

    # 베이스 위치 — 주지 않으면 몰드 중심에서 -X로 1900mm.
    # 웹 시뮬레이터가 베드를 X=1.4m에 두고 도달 스위트스폿을 확인한 값에서 왔다.
    base_given = robot_base is not None
    if robot_base is None:
        bb = rg.BoundingBox([t.Origin for t in tgts])
        c = bb.Center
        robot_base = rg.Plane(rg.Point3d(c.X - 1900.0, c.Y, 0.0),
                              rg.Vector3d.XAxis, rg.Vector3d.YAxis)

    picked = list(range(0, len(tgts), int(step)))
    sampled = [tgts[i] for i in picked]

    pose_list, results, flips = rb.track_toolpath(
        sampled, base_plane=robot_base,
        iterations=int(iterations), rot_weight=rot_weight)

    for p in pose_list:
        for j in rb.JOINT_NAMES:
            poses.append(p[j])

    reach_err = [r.pos_err_mm for r in results]
    unreachable = [picked[i] for i, r in enumerate(results)
                   if r.pos_err_mm > REACH_TOL_MM]

    # 현재 프레임 그리기
    fi = int(frame)
    if fi < 0:
        fi = 0
    if fi >= len(pose_list):
        fi = len(pose_list) - 1
    links = rb.link_lines_mm(pose_list[fi], base_plane=robot_base)
    tcp = rb.tcp_plane_mm(pose_list[fi])
    tcp.Transform(rg.Transform.PlaneToPlane(rg.Plane.WorldXY, robot_base))

    # 집계
    at_limit = {}
    for r in results:
        for j in r.at_limit:
            at_limit[j] = at_limit.get(j, 0) + 1

    worst_i = 0
    for i, r in enumerate(results):
        if r.pos_err_mm > results[worst_i].pos_err_mm:
            worst_i = i

    seconds = rb.cycle_time(pose_list)

    kinds = {}
    if move_kind:
        mk = list(move_kind)
        for i, r in zip(picked, results):
            if i < len(mk):
                k = str(mk[i])
                cur = kinds.get(k, [0, 0.0])
                cur[0] += 1
                cur[1] = max(cur[1], r.pos_err_mm)
                kinds[k] = cur

    lines = [
        "AMv1 Robot — IRB 6700-150/3.20",
        "=" * 44,
        "베이스:      {}".format("입력" if base_given else "자동"),
        "             원점 ({:.0f}, {:.0f}, {:.0f})".format(
            robot_base.Origin.X, robot_base.Origin.Y, robot_base.Origin.Z),
        "타겟:        {}개 중 {}개 계산 (step {})".format(
            len(tgts), len(sampled), int(step)),
        "",
        "위치 오차:   max {:.3f} mm  (타겟 #{})   평균 {:.3f} mm".format(
            max(reach_err) if reach_err else 0.0,
            picked[worst_i] if reach_err else -1,
            sum(reach_err) / len(reach_err) if reach_err else 0.0),
        "             <- {:.1f} mm 초과를 도달 실패로 본다".format(REACH_TOL_MM),
        "도달 실패:   {}개".format(len(unreachable)),
        "가동범위 접촉: {}".format(at_limit if at_limit else "없음"),
        "             <- 축이 한계에 걸리면 그 자세를 못 만든 것이다",
        "롤러 대칭 활용: {}회 뒤집음 / {}개".format(flips, len(sampled)),
        "             <- 원통 롤러는 축 부호가 무의미하다. 이 자유도를 쓰지",
        "                않으면 지그재그마다 손목이 180도씩 감긴다",
        "",
        "사이클 타임: {:.1f} 초 ({:.1f} 분) — 가감속 무시한 하한".format(
            seconds, seconds / 60.0),
    ]
    if kinds:
        lines.append("")
        lines.append("구간별 최대 오차:")
        for k in sorted(kinds.keys()):
            n, e = kinds[k]
            lines.append("  {:<9} {:>5}개  max {:.3f} mm".format(k, n, e))
    if int(step) > 1:
        lines += [
            "",
            "** step>1 이면 이 오차는 신뢰할 수 없다.",
            "   IK가 앞 포즈를 시드로 쓰는데 타겟을 건너뛰면 시드가 멀어져",
            "   수렴이 깨진다 (실측: step=10에서 max 1,850 mm).",
            "   미리보기 전용으로만 쓰고 판정은 step=1 로 할 것.",
        ]
    if unreachable:
        lines += [
            "",
            "** 도달 실패가 있다. 오차가 큰 지점은 롤러가 표면에서 뜬다.",
            "   실측: base_x -1400/-1300/-1200 비교에서 -1400이 최선이었고,",
            "   가까이 옮기면 나빠진다. X 이동으로는 더 못 줄인다 —",
            "   몰드 회전·높이(z)·베이스 기울기를 봐야 한다.",
        ]
    info = "\n".join(lines)

else:
    info = "compute=True 로 설정하고 RollerPath 의 targets 를 연결하세요."
# ---------- end amv1_robot ----------
amv1_pathframes = AMv1PathFrames(targets=amv1_rollerpath.targets, move_kind=amv1_rollerpath.move_kind, pick=0)  # -> out, pts, normal, tool_axis, roller, travel, pts_form, pts_air, info, path; inputs targets: list, move_kind: list, every: Double, n_len: Double, roller_w: Double, pick: Double
#   port targets: RollerPath 의 targets. list access. Plane 목록은 화면에서 자세가 보이지 않으므로 이 컴포넌트가 벡터로 펼쳐서 보여준다.
#   port move_kind: RollerPath 의 move_kind. 성형/공중 구분과 **패스 분할**에 쓴다. approach 가 새 패스의 시작이다. 연결하지 않으면 전체를 한 패스로 본다.
#   port every: N개마다 하나만 표시. 기본 5. 경로의 마지막 타겟은 항상 포함한다 — 끝이 잘려 보이면 오해를 만든다.
#   port n_len: 법선·진행 방향 표시 길이 (mm). 기본 60. 몰드가 1000mm급이면 60은 작게 보인다. 읽히지 않으면 키울 것.
#   port roller_w: 롤러 축 표시 길이 (mm). 기본 80. 실제 롤러 폭과 같게 두면 접촉선 길이를 눈으로 가늠할 수 있다.
#   port pick: 이 번호의 패스만 표시. -1(기본)이면 전체. 전 구간 1,175개를 한 번에 그리면 40mm 간격 패스 26본이 겹쳐 붉은 덩어리가 되어 아무것도 읽히지 않는다. 한 패스씩 보는 것이 기본 사용법이다. 슬라이더를 붙이면 패스를 훑어볼 수 있다.
#   port pts: 타겟 원점 = 롤러 중심. 접촉점이 아니다.
#   port normal: 곡면 법선 방향 선 (바깥쪽). 타겟의 -Z 방향.
#   port tool_axis: 공구가 내려누르는 방향 선. 타겟의 +Z 방향. 곡면을 향해야 정상이다. 바깥을 향하면 자세가 뒤집힌 것이다.
#   port roller: 롤러 축(접촉선) 선. 타겟의 Y 방향, 길이 roller_w. 이 선이 곡면에 나란히 누워야 선접촉이다.
#   port travel: 진행 방향 선. 타겟의 X 방향. 지그재그면 패스마다 반대를 향한다.
#   port pts_form: 성형 구간 점만 (가압하며 굴리는 구간).
#   port pts_air: 공중 구간 점만 (approach / retract / link).
#   port info: 요약 — 패스 개수, 선택된 패스, 표시 개수, 표시 규약.
#   port path: 표시 대상 타겟을 순서대로 이은 폴리라인. 로봇이 지나는 궤적이며, pick 으로 한 패스만 고르면 그 패스의 접근 → 성형 → 후퇴가 한 줄로 보인다.
# ---------- amv1_pathframes: Python ----------
# -*- coding: utf-8 -*-
# AMv1 PathFrames — 툴패스 타겟을 눈으로 읽을 수 있게 벡터로 펼친다
#
# targets 는 Plane 목록이라 화면에서 자세가 보이지 않는다. 각 타겟의
# 법선·롤러축·진행방향을 선으로 뽑아 경로가 곡면을 어떻게 따라가는지,
# 공구가 어디를 향하는지 확인한다.
#
# Inputs:
#   targets     Plane*  RollerPath 의 targets (list)
#   move_kind   str*    같은 순서의 구간 종류 (선택). 패스 분할에도 쓴다
#   pick        int     이 패스만 표시. -1(기본)이면 전체
#   every       int     N개마다 하나만 표시, 없으면 5
#   n_len       float   법선·진행 표시 길이, 없으면 60
#   roller_w    float   롤러 축 표시 길이, 없으면 80
#
# Outputs:
#   path        표시 대상 타겟을 순서대로 이은 폴리라인 — 로봇이 지나는 궤적
#   pts         타겟 원점 (= 롤러 중심)
#   normal      곡면 법선 방향 선 (바깥쪽) — 타겟의 -Z
#   tool_axis   공구 접근 방향 선 (곡면 쪽) — 타겟의 +Z
#   roller      롤러 축 선 (타겟의 Y, 길이 roller_w)
#   travel      진행 방향 선 (타겟의 X)
#   pts_form    성형 구간 점만
#   pts_air     공중 구간 점만 (approach/retract/link)
#   info        요약
#
# 전 구간(1,175개)을 한 번에 그리면 40mm 간격 패스 26본이 붉은 덩어리가 되어
# 아무것도 읽히지 않는다. pick 으로 한 패스씩 보는 것이 기본 사용법이다.

import Rhino.Geometry as rg


def _default(name, value, positive=False):
    g = globals()
    v = g.get(name)
    if v is None or (positive and v <= 0):
        g[name] = value


_default("every", 5, positive=True)
_default("n_len", 60.0, positive=True)
_default("roller_w", 80.0, positive=True)
_default("pick", -1)


path = None
pts = []
normal = []
tool_axis = []
roller = []
travel = []
pts_form = []
pts_air = []
info = ""


if targets:
    tg = list(targets)
    mk = [str(k) for k in move_kind] if move_kind else []
    n = int(every)

    # 패스 분할 — approach 가 새 패스의 시작이다. move_kind 가 없으면 전체 1개.
    bounds = [i for i, k in enumerate(mk) if k == "approach"]
    if not bounds:
        bounds = [0]
    spans = []
    for a, b in zip(bounds, bounds[1:] + [len(tg)]):
        spans.append((a, b))

    pi = int(pick)
    if 0 <= pi < len(spans):
        lo, hi = spans[pi]
        idx_all = list(range(lo, hi))
    else:
        pi = -1
        idx_all = list(range(len(tg)))

    idx = idx_all[::n]
    # 마지막 타겟은 항상 포함 — 경로 끝이 잘려 보이면 오해를 만든다
    if idx and idx_all and idx[-1] != idx_all[-1]:
        idx.append(idx_all[-1])

    for i in idx:
        pl = tg[i]
        o = pl.Origin
        z = rg.Vector3d(pl.ZAxis)          # 공구가 내려누르는 방향
        out = rg.Vector3d(z)
        out.Reverse()                      # 곡면 법선(바깥쪽)

        pts.append(o)
        normal.append(rg.Line(o, o + out * n_len))
        tool_axis.append(rg.Line(o, o + z * n_len))
        roller.append(rg.Line(o - pl.YAxis * (roller_w / 2.0),
                              o + pl.YAxis * (roller_w / 2.0)))
        travel.append(rg.Line(o, o + pl.XAxis * (n_len * 0.6)))

        kind = mk[i] if i < len(mk) else "form"
        if kind == "form":
            pts_form.append(o)
        else:
            pts_air.append(o)

    # 표시 대상을 순서대로 이은 궤적 — 이것이 "로봇이 지나는 경로"다
    if len(idx) > 1:
        path = rg.PolylineCurve([tg[i].Origin for i in idx])

    counts = {}
    for k in mk:
        counts[k] = counts.get(k, 0) + 1

    info = "\n".join([
        "AMv1 PathFrames",
        "=" * 40,
        "패스 {}개  |  선택 {}".format(
            len(spans), "전체" if pi < 0 else "#{} (타겟 {}~{})".format(
                pi, spans[pi][0], spans[pi][1] - 1)),
        "타겟 {}개 중 {}개 표시 (every {})".format(len(tg), len(pts), n),
        "성형 {} / 공중 {}".format(len(pts_form), len(pts_air)),
        "구간 구성(전체): {}".format(counts if counts else "move_kind 미연결"),
        "",
        "표시 규약:",
        "  path      = 표시 타겟을 순서대로 이은 궤적",
        "  normal    = 타겟 -Z, 곡면 바깥쪽 (길이 {:.0f})".format(n_len),
        "  tool_axis = 타겟 +Z, 공구가 내려누르는 방향",
        "  roller    = 타겟 Y, 접촉선 (길이 {:.0f})".format(roller_w),
        "  travel    = 타겟 X, 진행 방향",
        "",
        "** pick 에 0~{} 를 넣어 한 패스씩 볼 것.".format(max(0, len(spans) - 1)),
        "   전 구간을 한 번에 그리면 40mm 간격 패스가 겹쳐 덩어리로 보인다.",
    ])
else:
    info = "RollerPath 의 targets 를 연결하세요."
# ---------- end amv1_pathframes ----------
